# Grasshopper definition A2.gh (Grasshopper 1.0.7)

# ---- group: Generate and rebuild srf
crv = Curve(<curve referenced from the Rhino model>)
crv_2 = Curve(<curve referenced from the Rhino model>)
revsrf = Revolution(Curve=crv, Axis=crv_2, Domain=Domain(0, 6.283185307))
sdivide = DivideSurface(Surface=revsrf, UCount=Slider(4, range=0..100), VCount=Slider(3, range=0..100))  # -> Points, Normals, Parameters

# ----
tstat = TreeStatistics(Tree=sdivide.Points)  # -> Paths, Length, Count
panel = Panel(sdivide.Points)

# ---- group: Bottom left pts / Bottom right pts
toggle = BooleanToggle(False)
shift = ShiftList(List=tstat.Paths, Shift="-1", Wrap=toggle)
branch = TreeBranch(Tree=sdivide.Points, Path=shift, MaintainPaths=True)
shift_2 = ShiftList(List=branch, Shift="1", Wrap=toggle)
botton_left_pts = Point(shift_2)

# ---- group: Bottom left pts
toggle_2 = BooleanToggle(False)
shift_3 = ShiftList(List=tstat.Paths, Shift="-1", Wrap=toggle_2)
branch_2 = TreeBranch(Tree=sdivide.Points, Path=shift_3, MaintainPaths=True)
shift_4 = ShiftList(List=branch_2, Shift="-1", Wrap=toggle_2)
botton_left_pts_2 = Point(shift_4)

# ---- group: Bottom left pts / Top left pts
toggle_3 = BooleanToggle(False)
shift_5 = ShiftList(List=tstat.Paths, Shift="1", Wrap=toggle_3)
branch_3 = TreeBranch(Tree=sdivide.Points, Path=shift_5, MaintainPaths=True)
shift_6 = ShiftList(List=branch_3, Shift="-1", Wrap=toggle_3)
botton_left_pts_3 = Point(shift_6)

# ---- group: Bottom left pts / Top right pts
toggle_4 = BooleanToggle(False)
shift_7 = ShiftList(List=tstat.Paths, Shift="1", Wrap=toggle_4)
branch_4 = TreeBranch(Tree=sdivide.Points, Path=shift_7, MaintainPaths=True)
shift_8 = ShiftList(List=branch_4, Shift="1", Wrap=toggle_4)
botton_left_pts_4 = Point(shift_8)

# ----
points = PointList(Points=branch_2, Size=Slider(0.32, range=0..10))
boundary = BoundarySurfaces()
srf4pt = _4PointSurface(CornerA=botton_left_pts, CornerB=botton_left_pts_4, CornerC=botton_left_pts_3)
srf4pt_2 = _4PointSurface(CornerA=botton_left_pts_2, CornerB=botton_left_pts, CornerC=botton_left_pts_3)

# ---- group: panel 2
evalsrf = EvaluateSurface(Surface=srf4pt, Point=botton_left_pts)  # -> Point, Normal, UDirection, VDirection, Frame
vec = Vector(evalsrf.Normal)
unit = UnitVector(Vector=vec)
multiplication = Multiplication(A=unit, B=Slider(0.09, range=0..1))
neg = Negative(Value=multiplication)
extr = Extrude(Base=srf4pt, Direction=neg)

# ---- group: panel 1
evalsrf_2 = EvaluateSurface(Surface=srf4pt_2, Point=botton_left_pts_2)  # -> Point, Normal, UDirection, VDirection, Frame
vec_2 = Vector(evalsrf_2.Normal)
unit_2 = UnitVector(Vector=vec_2)
multiplication_2 = Multiplication(A=unit_2, B=Slider(0.09, range=0..1))
neg_2 = Negative(Value=multiplication_2)
extr_2 = Extrude(Base=srf4pt_2, Direction=neg_2)

# ---- group: connector 1
ln = Line(StartPoint=botton_left_pts_2, EndPoint=botton_left_pts)
midpt = CurveMiddle(Curve=ln)
circle = CircleCNR(Center=midpt, Normal=ln, Radius=Slider(0.5, range=0..10))
vec2pt = Vector2Pt(PointA=botton_left_pts, PointB=botton_left_pts_2, Unitize=Toggle(True))  # -> Vector, Length
vec2pt_2 = Vector2Pt(PointA=botton_left_pts_2, PointB=botton_left_pts, Unitize=Toggle(True))  # -> Vector, Length
number_slider = Slider(0.045, range=0..1)
multiplication_3 = Multiplication(A=vec2pt.Vector, B=number_slider)
multiplication_4 = Multiplication(A=vec2pt_2.Vector, B=number_slider)
extr_3 = Extrude(Base=circle, Direction=multiplication_3)
extr_4 = Extrude(Base=circle, Direction=multiplication_4)
cap = CapHoles(Brep=extr_4)
cap_2 = CapHoles(Brep=extr_3)

# ---- group: connector 3
ln_2 = Line(StartPoint=botton_left_pts, EndPoint=botton_left_pts_3)
midpt_2 = CurveMiddle(Curve=ln_2)
circle_2 = CircleCNR(Center=midpt_2, Normal=ln_2, Radius=Slider(0.5, range=0..10))
vec2pt_3 = Vector2Pt(PointA=botton_left_pts_3, PointB=botton_left_pts, Unitize=Toggle(True))  # -> Vector, Length
vec2pt_4 = Vector2Pt(PointA=botton_left_pts, PointB=botton_left_pts_3, Unitize=Toggle(True))  # -> Vector, Length
number_slider_2 = Slider(0.045, range=0..1)
multiplication_5 = Multiplication(A=vec2pt_3.Vector, B=number_slider_2)
multiplication_6 = Multiplication(A=vec2pt_4.Vector, B=number_slider_2)
extr_5 = Extrude(Base=circle_2, Direction=multiplication_5)
extr_6 = Extrude(Base=circle_2, Direction=multiplication_6)
cap_3 = CapHoles(Brep=extr_6)
cap_4 = CapHoles(Brep=extr_5)

# ---- group: connector 2
ln_3 = Line(StartPoint=botton_left_pts_2, EndPoint=botton_left_pts_3)
midpt_3 = CurveMiddle(Curve=ln_3)
circle_3 = CircleCNR(Center=midpt_3, Normal=ln_3, Radius=Slider(0.5, range=0..10))
vec2pt_5 = Vector2Pt(PointA=botton_left_pts_3, PointB=botton_left_pts_2, Unitize=Toggle(True))  # -> Vector, Length
vec2pt_6 = Vector2Pt(PointA=botton_left_pts_2, PointB=botton_left_pts_3, Unitize=Toggle(True))  # -> Vector, Length
number_slider_3 = Slider(0.045, range=0..1)
multiplication_7 = Multiplication(A=vec2pt_5.Vector, B=number_slider_3)
multiplication_8 = Multiplication(A=vec2pt_6.Vector, B=number_slider_3)
extr_7 = Extrude(Base=circle_3, Direction=multiplication_7)
extr_8 = Extrude(Base=circle_3, Direction=multiplication_8)
cap_5 = CapHoles(Brep=extr_8)
cap_6 = CapHoles(Brep=extr_7)
